# Dynamo graph dynamicSectionView.dyn (Dynamo 1.2.1.3083)

code_block = CodeBlock { "C:\Dynamo\ViewRange\\test_views\slice1"; 1; "Scope Box 3"; }
categories = Categories("VolumeOfInterest")
all_elements_of_category = ElementsOfCategory(categories)
name = Element.Name(all_elements_of_category)
eq = name == code_block.out2
filterByBoolMask = List.FilterByBoolMask(list=all_elements_of_category, mask=eq)
code_block_2 = CodeBlock(x=filterByBoolMask.in) { x[0]; }
dynamicsectionview_python_script = Python(IN[0]=code_block.out0, IN[1]=code_block.out1, IN[2]=code_block_2)
# ---------- dynamicsectionview_python_script.python (122 lines) ----------
import clr
clr.AddReference('ProtoGeometry')
from Autodesk.DesignScript.Geometry import *

# Import Element wrapper extension methods
clr.AddReference('RevitNodes')
import Revit
clr.ImportExtensions(Revit.Elements)

# Import geometry conversion extension methods
clr.ImportExtensions(Revit.GeometryConversion)

# Import DocumentManager and TransactionManager
clr.AddReference('RevitServices')
import RevitServices
from RevitServices.Persistence import DocumentManager
from RevitServices.Transactions import TransactionManager

# Import RevitAPI
clr.AddReference('RevitAPI')
import Autodesk
from Autodesk.Revit.DB import *
from Autodesk.Revit.DB import FilteredElementCollector as _FilteredElementCollector
from Autodesk.Revit.DB import ViewFamilyType as _ViewFamilyType

import System
from System import Array
from System.Collections.Generic import *

import sys


def get_ViewFamilyTypeId(viewFamilyTypeName):	
	names = []
	ids = []
	viewFamilyTypeId = -1
	collector = _FilteredElementCollector(doc).OfClass(_ViewFamilyType) #collecting all elements of type ViewFamilyType
	for t in collector:
		names.append(t.FamilyName)
		ids.append(t.Id)
		if t.FamilyName == viewFamilyTypeName:
			viewFamilyTypeId = t.Id
			break # get the first
	return viewFamilyTypeId
			
			
def create_view(doc, viewFamilyTypeId, boundingBox):			
	if viewFamilyTypeId != -1:
		TransactionManager.Instance.EnsureInTransaction(doc)	
		sectionView = ViewSection.CreateDetail(doc, viewFamilyTypeId, boundingBox) # http://www.revitapidocs.com/2016/834e7154-b2f0-ffcd-b04a-9ad8cee321c8.htm
		TransactionManager.Instance.TransactionTaskDone()
		return sectionView


def exportViewImage(view, path, pixel_size):
	ieo = ImageExportOptions()
	ieo.ExportRange = ExportRange.SetOfViews
	ieo.SetViewsAndSheets([view.Id])
	ieo.ViewName = view.ViewName
	ieo.FilePath = path	
	ieo.HLRandWFViewsFileType = ImageFileType.PNG
	ieo.ShadowViewsFileType = ImageFileType.PNG
	#ieo.PixelSize = pixel_size
	doc.ExportImage(ieo)
	return ieo


def scopeBox2cropBox(scopeBox, viewFamilyTypeId, bbx):
	TransactionManager.Instance.EnsureInTransaction(doc)
	sectionView = ViewSection.CreateDetail(doc, viewFamilyTypeId, bbx) # http://www.revitapidocs.com/2016/834e7154-b2
	param = sectionView.get_Parameter(BuiltInParameter.VIEWER_VOLUME_OF_INTEREST_CROP)
	param.Set(scopeBox.Id)
	TransactionManager.Instance.TransactionTaskDone()
	return sectionView


filePath = IN[0]
voxel_size = IN[1]
scopeBox = UnwrapElement(IN[2])
doc = DocumentManager.Instance.CurrentDBDocument
try:
	pre_i = 0 # slow issue: delete the first picture
	pre_j = 0
	count = -1
	
	viewFamilyTypeId = get_ViewFamilyTypeId("Detail View")
	boundingBox = BoundingBoxXYZ() 
	sectionView = scopeBox2cropBox(scopeBox, viewFamilyTypeId, boundingBox)
	
	cropBox = sectionView.CropBox
	minPoint = cropBox.Min
	maxPoint = cropBox.Max
	bottom = minPoint.Z
	top = maxPoint.Z
	height = 0
	digit = len(str(int((top - bottom) / voxel_size))) 
	
	secionViews = []
	
	while height + bottom < top:
		if count > 50:
			break
	
		height += voxel_size # trigger 1st round
		bbx = BoundingBoxXYZ()
		bbx.Min = XYZ(minPoint.X, minPoint.Y, min(minPoint.Z + height, maxPoint.Z) + 200)
		bbx.Max = XYZ(maxPoint.X, maxPoint.Y, maxPoint.Z + 200)
		sectionView_t = create_view(doc, viewFamilyTypeId, bbx)
		secionViews.append(sectionView_t)
			
		#bbox = sectionView.CropBox # get view's cropbox coordinates
		#pixel_size = (bbox.Max.X - bbox.Min.X) * 12 * voxel_size
		
		pixel_size = 0.01 * 12 * voxel_size # trigger 2nd round
		imageName = filePath + str(count).rjust(digit)
		ieo = exportViewImage(sectionView_t, imageName, pixel_size)
			
		count += 1
		
	OUT = "succeed", sectionView, bottom, top, secionViews
except Exception as e:
	OUT =  e
# ----------------------------------------
parameters = Element.Parameters(filterByBoolMask.in)
